# Grasshopper definition beam_joints.gh (Grasshopper 1.0.7)

# ----
# Auto Create Lap Joints on Intersecting beams
number_slider = Slider(700, range=0..1000)
pt = ConstructPoint(XCoordinate=number_slider, YCoordinate=Slider(500, range=0..1000), ZCoordinate=0)
pt_2 = ConstructPoint(XCoordinate=Slider(0, range=0..1000), YCoordinate=Slider(629, range=0..1000), ZCoordinate=0)
xy = XYPlane(Origin=pt)
prot = RotatePlane(Plane=xy, Angle=degrees(Slider(140, range=-80..180)))
beam = GhPythonScript(
    plane=prot,
    length=Slider(700, range=0..2000),
    width=Slider(100, range=0..100),
    height=Slider(100, range=0..1000),
    name="b2")  # -> out, beam, assembly; inputs plane: Plane
# ---------- beam: Python ----------
from compas_rhino.geometry import RhinoMesh, RhinoPlane

from integral_timber_joints.geometry import Beam
from integral_timber_joints.assembly import Assembly

frame = RhinoPlane.from_geometry(plane).to_compas()

beam = Beam(frame, length, width, height, name)

assembly = Assembly()
assembly.add_beam(beam)
assembly.update_beam_mesh_with_joints(name, True)
# ---------- end beam ----------
xy_2 = XYPlane(Origin=pt_2)
prot_2 = RotatePlane(Plane=xy_2, Angle=degrees(Slider(0, range=0..100)))
beam_2 = GhPythonScript(
    plane=prot_2,
    length=Slider(800, range=0..3000),
    width=Slider(100, range=0..100),
    height=Slider(100, range=0..1000),
    name="b1")  # -> out, beam, assembly; inputs plane: Plane; same code as beam
join_halflap = GhPythonScript(beam1=beam_2.beam, beam2=beam.beam)  # -> out, assembly, joint1_mesh, joint2_mesh
# ---------- join_halflap: Python ----------
from compas_ghpython import unload_modules
unload_modules('integral_timber_joints')
from integral_timber_joints.assembly import Assembly
from integral_timber_joints.geometry import Joint_halflap_from_beam_beam_intersection
assembly = Assembly()
assembly.add_beam(beam1)
assembly.add_beam(beam2)

joint1, joint2 = Joint_halflap_from_beam_beam_intersection(beam1, beam2)
assembly.add_joint_pair(joint1, joint2, beam1.name, beam2.name)

assembly.update_beam_mesh_with_joints(beam1.name, True)
assembly.update_beam_mesh_with_joints(beam2.name, True)

from compas_ghpython.artists import MeshArtist
joint1_mesh = MeshArtist(joint1.get_feature_mesh(assembly.beam(beam1.name))).draw()
joint2_mesh = MeshArtist(joint2.get_feature_mesh(assembly.beam(beam2.name))).draw()

print joint1.distance
print joint2.distance
# ---------- end join_halflap ----------
basic_assembly_preview = GhPythonScript(assembly=join_halflap.assembly, beam_ids="b1")  # -> out, beam_mesh_prev; inputs beam_ids: list
# ---------- basic_assembly_preview: Python ----------
from compas_ghpython.artists import MeshArtist

beam_mesh_prev = []
if beam_ids == []:
    beam_ids = assembly.beam_ids()
    
for beam_id in beam_ids:
    beam = assembly.beam(beam_id)
    beam_mesh_prev.append(MeshArtist(beam.cached_mesh).draw())
# ---------- end basic_assembly_preview ----------
basic_assembly_preview_2 = GhPythonScript(assembly=join_halflap.assembly, beam_ids="b2")  # -> out, beam_mesh_prev; inputs beam_ids: list; same code as basic_assembly_preview
preview = CustomPreview(Geometry=join_halflap.joint2_mesh, Material=ColourSwatch(SwatchColor=RGBA(0, 255, 204, 148)))
Z = UnitZ(Factor=120)
move = Move(Geometry=basic_assembly_preview.beam_mesh_prev, Motion=Z)  # -> Geometry, Transform
preview_2 = CustomPreview(Geometry=move.Geometry, Material=ColourSwatch(SwatchColor=RGBA(0, 255, 204, 148)))
preview_3 = CustomPreview(Geometry=basic_assembly_preview_2.beam_mesh_prev, Material=ColourSwatch(SwatchColor=RGBA(0, 255, 204, 148)))

# ----
# Reload Python Modules (if Module Code is Changed)
python_module_to_reload = Panel("""compas
compas_fab
roslibpy
integral_timber_joints""")
# Development Tools
reload = Button()
py = PythonScript(reload_module_button=reload, module_names=python_module_to_reload)  # inputs module_names: list
# ---------- py: Python ----------
import compas_ghpython
from compas_ghpython import unload_modules
if reload_module_button:
    for module in module_names:
        unload_modules(module)
# ---------- end py ----------

# ----
# Lap Joint on just one side
number_slider_2 = Slider(1000, range=0..1000)
xy_3 = XYPlane(Origin=Point(0, 0, 0))
beam_3 = GhPythonScript(plane=xy_3, length=number_slider_2, width=Slider(100, range=0..100), height=Slider(140, range=0..1000), name="b1")  # -> out, beam, assembly; inputs plane: Plane; same code as beam
joint_90lap = GhPythonScript(
    assembly=beam_3.assembly,
    face_id=Slider(1, range=1..4),
    distance=Slider(309, range=0..1000),
    width=Slider(85, range=0..100),
    length=Slider(84, range=0..100),
    height=Slider(36, range=0..100))  # -> out, assembly_out
# ---------- joint_90lap: Python ----------
from integral_timber_joints.geometry import Beam, Joint_90lap
from copy import deepcopy

empty_beam = Beam(None,1,2,3,'b2')
assembly_out = deepcopy(assembly)

assembly_out.add_beam(empty_beam)

joint = Joint_90lap(distance, face_id, length, width, height)
assembly_out.add_one_joint(joint, assembly_out.sequence[0], assembly_out.sequence[1])
assembly_out.update_beam_mesh_with_joints(assembly_out.sequence[0])
# ---------- end joint_90lap ----------
basic_assembly_preview_3 = GhPythonScript(assembly=joint_90lap.assembly_out, beam_ids="b1")  # -> out, beam_mesh_prev; inputs beam_ids: list
# ---------- basic_assembly_preview_3: Python ----------
from compas_ghpython.artists import MeshArtist

beam_mesh_prev = []
if beam_ids == []:
    beam_ids = assembly.beam_ids()

for beam_id in beam_ids:
    beam = assembly.beam(beam_id)
    beam_mesh_prev.append(MeshArtist(beam.cached_mesh).draw())
# ---------- end basic_assembly_preview_3 ----------
preview_4 = CustomPreview(Geometry=basic_assembly_preview_3.beam_mesh_prev, Material=ColourSwatch(SwatchColor=RGBA(102, 255, 0, 148)))

# ----
# Lap Joint on just one side
number_slider_3 = Slider(1000, range=0..1000)
xy_4 = XYPlane(Origin=Point(0, 200, 0))
beam_4 = GhPythonScript(plane=xy_4, length=number_slider_3, width=Slider(100, range=0..100), height=Slider(100, range=0..1000), name="b1")  # -> out, beam, assembly; inputs plane: Plane; same code as beam
joint_halflap = GhPythonScript(
    assembly=beam_4.assembly,
    face_id=Slider(4, range=1..4),
    angle=Slider(121, range=10..170),
    distance=Slider(245, range=0..1000),
    width=Slider(100, range=0..100),
    length=Slider(43, range=0..100),
    height=Slider(40, range=0..100))  # -> out, assembly_out, joint_mesh
# ---------- joint_halflap: Python ----------
from integral_timber_joints.geometry import Beam, Joint_halflap
from copy import deepcopy

from compas_ghpython.artists import MeshArtist

empty_beam = Beam(None,1,2,3,'b2')
assembly_out = deepcopy(assembly)

assembly_out.add_beam(empty_beam)

joint = Joint_halflap(face_id, distance, angle, length, width, height)
assembly_out.add_one_joint(joint, assembly_out.sequence[0], assembly_out.sequence[1])
assembly_out.update_beam_mesh_with_joints(assembly_out.sequence[0])

joint_mesh = MeshArtist(joint.get_feature_mesh(assembly_out.beam(assembly_out.sequence[0]))).draw()
# ---------- end joint_halflap ----------
basic_assembly_preview_4 = GhPythonScript(assembly=joint_halflap.assembly_out, beam_ids="b1")  # -> out, beam_mesh_prev; inputs beam_ids: list; same code as basic_assembly_preview
clamp_frame = GhPythonScript(assembly=joint_halflap.assembly_out, beam_id="b1")  # -> out, frames, b
# ---------- clamp_frame: Python ----------
frames = []

from compas_ghpython import draw_frame
for joint in assembly.get_joints_of_beam(beam_id):
    for frame in joint.get_clamp_frames(assembly.beam(beam_id)):
        frames.append(draw_frame(frame))
# ---------- end clamp_frame ----------
item = ListItem(List=clamp_frame.frames, Index=0, Wrap=True)
preview_5 = CustomPreview(Geometry=basic_assembly_preview_4.beam_mesh_prev, Material=ColourSwatch(SwatchColor=RGBA(102, 255, 0, 148)))

# ----
# Check Path and Environment
compas_version = GhPythonScript()  # -> out, compas_version, compas_fab_version, compas_path, compas_fab_path, compas_env_name, python_directory
# ---------- compas_version: Python ----------
__author__ = "leungp"
__version__ = "2020.04.20"

import rhinoscriptsyntax as rs
import compas
import compas_fab
compas_version  = compas.__version__
compas_fab_version = compas_fab.__version__
import os
compas_path = os.path.abspath(compas.__file__)
compas_fab_path = os.path.abspath(compas_fab.__file__)

import compas_bootstrapper
compas_env_name = compas_bootstrapper.ENVIRONMENT_NAME
python_directory = compas_bootstrapper.PYTHON_DIRECTORY
# ---------- end compas_version ----------
compas_environment_name = Panel(compas_version.compas_env_name)
compas_version_2 = Panel(compas_version.compas_version)
compas_fab_version = Panel(compas_version.compas_fab_version)
compas_path = Panel(compas_version.compas_path)
compas_fab_path = Panel(compas_version.compas_fab_path)
python_directory = Panel(compas_version.python_directory)

# ----
# Simulating Flip Joint
swap_faceid_to_opposite_face = GhPythonScript(assembly=joint_halflap.assembly_out)  # -> out, assembly_out
# ---------- swap_faceid_to_opposite_face: Python ----------
from copy import deepcopy

from compas_ghpython.artists import MeshArtist

assembly_out = deepcopy(assembly)
beam_id = assembly_out.sequence[0]
assembly_out.joint((assembly_out.sequence[0], assembly_out.sequence[1])).swap_faceid_to_opposite_face()
assembly_out.update_beam_mesh_with_joints(beam_id)
# ---------- end swap_faceid_to_opposite_face ----------
basic_assembly_preview_5 = GhPythonScript(assembly=swap_faceid_to_opposite_face.assembly_out, beam_ids="b1")  # -> out, beam_mesh_prev; inputs beam_ids: list; same code as basic_assembly_preview
Z_2 = UnitZ(Factor=Slider(237, range=0..1000))
move_2 = Move(Geometry=basic_assembly_preview_5.beam_mesh_prev, Motion=Z_2)  # -> Geometry, Transform
preview_6 = CustomPreview(Geometry=move_2.Geometry, Material=ColourSwatch(SwatchColor=RGBA(255, 149, 0, 148)))

# ----
# Auto Create Lap Joints on Intersecting beams
number_slider_4 = Slider(0, range=0..1000)
number_slider_5 = Slider(800, range=0..3000)
number_slider_6 = Slider(100, range=0..100)
number_slider_7 = Slider(100, range=0..200)
pt_3 = ConstructPoint(XCoordinate=number_slider_4, YCoordinate=Slider(1200, range=0..2100), ZCoordinate=0)
xy_5 = XYPlane(Origin=pt_3)
prot_3 = RotatePlane(Plane=xy_5, Angle=degrees(Slider(22, range=0..100)))
beam_5 = GhPythonScript(plane=prot_3, length=number_slider_5, width=number_slider_6, height=number_slider_7, name="b1")  # -> out, beam, assembly; inputs plane: Plane; same code as beam

pln = Plane(prot_3)
deplane = DeconstructPlane(Plane=pln)  # -> Origin, XAxis, YAxis, ZAxis
amp = Amplitude(Vector=deplane.YAxis, Amplitude=expr("x/2", number_slider_7))
amp_2 = Amplitude(Vector=deplane.XAxis, Amplitude=expr("x/2", number_slider_5))
amp_3 = Amplitude(Vector=deplane.ZAxis, Amplitude=expr("x/2", number_slider_6))
addition = Addition(A=amp_2, B=amp, C=amp_3)
move_3 = Move(Geometry=pln, Motion=addition)  # -> Geometry, Transform

axle_angle = Slider(-18, range=-100..100)
out_of_plane_angle = Slider(-19, range=-50..50)
plane_angle = Slider(99, range=25..155)
downward_offset = Slider(25, range=-20..60)
pln_joint_center = Plane(move_3.Geometry)
deplane_2 = DeconstructPlane(Plane=pln_joint_center)  # -> Origin, XAxis, YAxis, ZAxis
neg = Negative(Value=downward_offset)
rot3d = Rotate3D(Geometry=pln_joint_center, Angle=degrees(axle_angle), Center=pln_joint_center, Axis=deplane_2.XAxis)  # -> Geometry, Transform
rot3d_2 = Rotate3D(Geometry=rot3d.Geometry, Angle=degrees(out_of_plane_angle), Center=pln_joint_center, Axis=deplane_2.YAxis)  # -> Geometry, Transform
amp_4 = Amplitude(Vector=deplane_2.ZAxis, Amplitude=neg)
rot3d_3 = Rotate3D(Geometry=rot3d_2.Geometry, Angle=degrees(plane_angle), Center=pln_joint_center, Axis=deplane_2.ZAxis)  # -> Geometry, Transform
move_4 = Move(Geometry=rot3d_3.Geometry, Motion=amp_4)  # -> Geometry, Transform
pln_2 = Plane(move_4.Geometry)

number_slider_8 = Slider(100, range=0..200)
number_slider_9 = Slider(800, range=0..3000)
number_slider_10 = Slider(100, range=0..100)
pln_3 = Plane(pln_2)
deplane_3 = DeconstructPlane(Plane=pln_3)  # -> Origin, XAxis, YAxis, ZAxis
amp_5 = Amplitude(Vector=deplane_3.YAxis, Amplitude=expr("x/2", number_slider_8))
amp_6 = Amplitude(Vector=deplane_3.XAxis, Amplitude=expr("x/2", number_slider_9))
amp_7 = Amplitude(Vector=deplane_3.ZAxis, Amplitude=expr("x/2", number_slider_10))
addition_2 = Addition(A=amp_6, B=amp_5, C=amp_7)
rev = Reverse(Vector=addition_2)
move_5 = Move(Geometry=pln_3, Motion=rev)  # -> Geometry, Transform
pln_4 = Plane(move_5.Geometry)
beam_6 = GhPythonScript(plane=pln_4, length=number_slider_9, width=number_slider_10, height=number_slider_8, name="b2")  # -> out, beam, assembly; inputs plane: Plane; same code as beam
basic_assembly_preview_6 = GhPythonScript(assembly=beam_6.assembly)  # -> out, beam_mesh_prev; inputs beam_ids: list; disabled; same code as basic_assembly_preview_3
swatch = ColourSwatch(SwatchColor=RGBA(255, 157, 0, 148))  # disabled
preview_7 = CustomPreview(Geometry=basic_assembly_preview_6.beam_mesh_prev, Material=swatch)  # disabled

basic_assembly_preview_7 = GhPythonScript(assembly=beam_5.assembly)  # -> out, beam_mesh_prev; inputs beam_ids: list; disabled; same code as basic_assembly_preview_3
join_2_2_nonplanarlap = GhPythonScript(beam_move=beam_5.beam, beam_stay=beam_6.beam, joint_thickness=Slider(70, range=0..100))  # -> out, assembly, joint1_mesh, joint2_mesh, test
# ---------- join_2_2_nonplanarlap: Python ----------
from compas_ghpython import unload_modules
unload_modules('integral_timber_joints')
from integral_timber_joints.assembly import Assembly
from integral_timber_joints.geometry import non_planar_lap_joint_from_beam_beam_intersection

assembly = Assembly()
assembly.add_beam(beam_move)
assembly.add_beam(beam_stay)

joint_m, joint_s = non_planar_lap_joint_from_beam_beam_intersection(beam_move, beam_stay, joint_thickness)

assembly.add_joint_pair(joint_m, joint_s, beam_move.name, beam_stay.name)

from compas_ghpython.artists import MeshArtist
joint1_mesh = MeshArtist(joint_m.get_feature_mesh(assembly.beam(beam_move.name))).draw()
joint2_mesh = MeshArtist(joint_s.get_feature_mesh(assembly.beam(beam_stay.name))).draw()


assembly.update_beam_mesh_with_joints(beam_move.name, True)
assembly.update_beam_mesh_with_joints(beam_stay.name, True)

#############

a = beam_move.draw_uncut_mesh()
b = joint_m.get_feature_mesh(assembly.beam(beam_move.name))

a.quads_to_triangles()
b.quads_to_triangles()

from compas.datastructures import Mesh, mesh_offset
b = mesh_offset(b, 0.01)

from compas.rpc import Proxy
proxy = Proxy()
proxy.package = 'compas_cgal.booleans'
result_v_f = proxy.boolean_difference(a.to_vertices_and_faces(), b.to_vertices_and_faces())

test = MeshArtist(Mesh.from_vertices_and_faces(* result_v_f)).draw()
# ---------- end join_2_2_nonplanarlap ----------
swatch_2 = ColourSwatch(SwatchColor=RGBA(102, 255, 0, 148))  # disabled
preview_8 = CustomPreview(Geometry=basic_assembly_preview_7.beam_mesh_prev, Material=swatch_2)  # disabled
basic_assembly_preview_8 = GhPythonScript(assembly=join_2_2_nonplanarlap.assembly, beam_ids="b1")  # -> out, beam_mesh_prev; inputs beam_ids: list; same code as basic_assembly_preview
basic_assembly_preview_9 = GhPythonScript(assembly=join_2_2_nonplanarlap.assembly, beam_ids="b2")  # -> out, beam_mesh_prev; inputs beam_ids: list; same code as basic_assembly_preview
Z_3 = UnitZ(Factor=120)
move_6 = Move(Geometry=basic_assembly_preview_8.beam_mesh_prev, Motion=Z_3)  # -> Geometry, Transform
preview_9 = CustomPreview(Geometry=move_6.Geometry, Material=ColourSwatch(SwatchColor=RGBA(0, 255, 47, 148)))
preview_10 = CustomPreview(Geometry=basic_assembly_preview_9.beam_mesh_prev, Material=ColourSwatch(SwatchColor=RGBA(0, 255, 204, 148)))
